% Simulink data dictionary Properties.sldd

Car_mass = Simulink.Parameter(245, DataType="double", Unit="kg")
Wheel_inertia = Simulink.Parameter(0.0205, DataType="double", Unit="kg*m^2")
Engine_inertia = Simulink.Parameter(0.0896, DataType="double", Unit="kg*m^2")
Loaded_radius = Simulink.Parameter(0.2, DataType="double", Unit="m")
Effective_radius = Simulink.Parameter(0.2, DataType="double", Unit="m")
Transmission_ratios = Simulink.Parameter([0 0; 1 2.583; 2 2; 3 1.667; 4 1.444; 5 1.286; 6 1.15], DataType="double", Unit="1")
Rear_axles_omega = Simulink.Parameter(145, Unit="rad/s")
Brake_radius = Simulink.Parameter(0.1, DataType="double", Unit="m")